# Grasshopper definition Herring_brick_fabrication_comb.ghx (Grasshopper 1.0.7)

# ---- group: Oriented plan
panel = Panel("""{299, 63, 0}
{499, 63, 0}
{499, 299, 0}""")
# Create Bricks
number_slider = Slider(20, range=0..100)
pt = Point(panel)
pline = PolyLine(Vertices=pt, Closed=False)
points = PointList(Points=pt, Size=number_slider)

# ----
# Main Program
robotmodel = Geometry([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])
division = Division(A="180", B=Slider(40, range=0..100))
# Roate decrease number of brick by Rules
number_slider_2 = Slider(5, range=0..100)
rotation_of_each_layer = Panel(division)
rotate_center = Point(Point(-0.03039079075, -0.003853279266, 0))

# ---- group: HerringBrcik
python = GhPythonScript(plan_depth=number_slider_2, height=Slider(3, range=0..100), angle_vetical=division, center_point=rotate_center)  # -> out, planes, planes_base, meshes; inputs plan_depth: Int32, height: Int32, center_point: Point3d
# ---------- python: Python ----------
from compas_rhino import unload_modules
unload_modules('model')
from model import Brick
import Rhino.Geometry as rg
import math

### this funtion is plane for herring bone
def herring_bone(plan_depth ,x_postion ,y_postion, z_postion, angle):
    """
    x_postion is brick X coordinate
    y_postion is brick Y coordinate
    z_postion is brick z coordinate
    angle is brick place direction
    """
    planes = [] # Top plane for robot picking up
    planes_base = [] # base plane for create visual brick
    # horizontal gap
    gap_hori = Brick.REFERENCE_WIDTH +2.5
    for i in range(plan_depth):
        x_value = gap_hori * i + x_postion
        y_value = gap_hori * i + y_postion
        z_value = z_postion
        
        # create brick plane
        plane_origin = rg.Point3d(x_value, y_value, z_value)
        brick_plane = rg.Plane(plane_origin, rg.Vector3d.XAxis, rg.Vector3d.YAxis)
        brick_plane.Rotate(math.radians(angle), rg.Vector3d.ZAxis)
        planes_base.append(brick_plane)
        plane_rot = brick_plane.Clone()
        brick_rot = Brick(plane_rot)
        planes.append(brick_rot.picking_plane())
    return planes, planes_base


# rotate plane 
def rotateBycentre(planes, angle, center_point):
    center_point = c_p # rotate centre
    plane_rot =[] 
    for p in planes:
        T = rg.Transform.Rotation(angle, c_p)
        p.Transform(T)
        plane_rot.append(p)
    return plane_rot

#####          #####
##### RUN CODE #####
#####          #####

# define the x_postion and y_postion for bricks
## modify brick gap here
b_leng = Brick.REFERENCE_LENGTH
b_wid = Brick.REFERENCE_WIDTH

x_p_R1, y_p_R1 = b_leng +0.8, b_wid/2
x_p_R2, y_p_R2 = b_wid/2, b_leng/2
x_p_L1, y_p_L1 = -.5, b_leng + b_wid/2 +1.3
x_p_L2, y_p_L2 = -1*(b_leng/2 + b_wid/2 + 1.8), b_leng + b_wid +1.8

##########
meshes =[]
planes = []
planes_base = []

# stacking
for i in range(height):
    b_h = Brick.REFERENCE_HEIGHT 
    c_p = center_point # rotate centre
    angle = math.radians(angle_vetical)
    
    # create pattern by remove last brick 
    if i % 2 ==0:
        # create plane
        planes_r1, planes_base_r1 = herring_bone(plan_depth, x_p_R1, y_p_R1, b_h *i, 0)
        planes_r2, planes_base_r2 = herring_bone(plan_depth, x_p_R2, y_p_R2, b_h *i, 90)
        planes_r3, planes_base_r3 = herring_bone(plan_depth, x_p_L1, y_p_L1, b_h *i, 0)
        planes_r4, planes_base_r4 = herring_bone(plan_depth, x_p_L2, y_p_L2, b_h *i, 90)
        planes.append(planes_r1
                    + planes_r2 
                    + planes_r3
                    + planes_r4)
                    
        planes_base.append(planes_base_r1
                        + planes_base_r2
                        + planes_base_r3
                        + planes_base_r4)
    elif i % 2 ==1:
        planes_r1, planes_base_r1 = herring_bone(plan_depth, x_p_R1, y_p_R1, b_h *i, 90)
        planes_r2, planes_base_r2 = herring_bone(plan_depth, x_p_R2, y_p_R2, b_h *i, 0)
        planes_r3, planes_base_r3 = herring_bone(plan_depth, x_p_L1, y_p_L1, b_h *i, 90)
        planes_r4, planes_base_r4 = herring_bone(plan_depth, x_p_L2, y_p_L2, b_h *i, 0)
        planes.append(planes_r1
                    + planes_r2 
                    + planes_r3
                    + planes_r4)
        planes_base.append(planes_base_r1
                        + planes_base_r2
                        + planes_base_r3
                        + planes_base_r4)
    #############
    rotateBycentre(planes_r1, angle*i, c_p)
    rotateBycentre(planes_r2, angle*i, c_p)
    rotateBycentre(planes_r3, angle*i, c_p)
    rotateBycentre(planes_r4, angle*i, c_p)
    
    rotateBycentre(planes_base_r1, angle*i, c_p)
    rotateBycentre(planes_base_r2, angle*i, c_p)
    rotateBycentre(planes_base_r3, angle*i, c_p)
    rotateBycentre(planes_base_r4, angle*i, c_p)
########


# all meshes
#meshes =[]
for plane in planes_base:
    for p in plane:
        b = Brick(p)
        meshes.append(b.mesh())
# ---------- end python ----------

# ---- group: planes
unpack = GhPythonScript(Tree=python.planes)  # -> simplify(Upackdata)
# ---------- unpack: Python ----------
### unpack IRONPYTHON
Upackdata = Tree
# ---------- end unpack ----------

# ---- group: planes_base
unpack_2 = GhPythonScript(Tree=python.planes_base)  # -> simplify(Upackdata); same code as unpack

# ----
unflatten = UnflattenTree(Tree=python.meshes, Guide=unpack_2)
plane_for_visualization = Plane(flatten(unpack_2))
planetorobot = Plane(flatten(unpack))
bricks = Mesh(unflatten)
# Visualization
python_2 = GhPythonScript(Base_plane=plane_for_visualization)  # -> out, bricks; inputs Base_plane: list
# ---------- python_2: Python ----------
import rhinoscriptsyntax as rs
import Rhino.Geometry as rg
import ghpythonlib.components as gh

from model import Brick

def set_robot_base_plane_from_pts():
    pt_0 = rg.Point3d(299, 63, -0)  # base plane origin
    # point on base plane positive x direction
    pt_1 = rg.Point3d(499, 63, 0)
    pt_2 = rg.Point3d(499, 299, 0)  # point on base plane positive xy

    robot_base = rg.Plane(pt_0, pt_1-pt_0, pt_2-pt_0)
    return robot_base

def rhino_to_robot_space(rhino_plane):
    """ this funktion translates planes from the rhino cordinate system to
    the robot cordinate system 
    """
    robot_plane = rhino_plane.Clone()
    _r_matrix = rg.Transform.PlaneToPlane(rg.Plane.WorldXY, set_robot_base_plane_from_pts())
    robot_plane.Transform(_r_matrix)
    return robot_plane

###          ### 
### Run Code ###
###          ###
bricks = []
for plane in Base_plane:
    planes = rhino_to_robot_space(plane)
    b = Brick(planes)
    bricks.append(b.mesh())
# ---------- end python_2 ----------

# ---- group: Total Counts
lng = ListLength(List=flatten(bricks))
panel_2 = Panel(lng)

# ---- group: SEND TO ROBOT
button = Button()

# ----
# Robotic Fabrication
plane = Geometry(flatten(planetorobot))
fabrication = GhPythonScript(way_plane=plane, send=button)  # -> out, robot_planes, pick_up_planes, glue_plane, script; inputs way_plane: list
# ---------- fabrication: Python ----------
from compas_rhino import unload_modules
unload_modules('model')
from model import Brick

import Rhino.Geometry as rg
import simple_comm as c
import simple_ur_script as ur
import math as m


rhino_base_way_planes = way_plane

def tcp(script):
    """ This funktion sets tcp 
    """
    script += ur.set_tcp_by_angles(
        0.0, 0.0, 70, m.radians(0.0), m.radians(180.0), m.radians(0))
    return script


### set robot orint plane
def set_robot_base_plane_from_pts():

    pt_0 = rg.Point3d(299, 63, 0)  # base plane origin
    # point on base plane positive x direction
    pt_1 = rg.Point3d(499, 63, 0)
    pt_2 = rg.Point3d(499, 299, 0)  # point on base plane positive xy

    robot_base = rg.Plane(pt_0, pt_1-pt_0, pt_2-pt_0)
    return robot_base

def rhino_to_robot_space(rhino_plane):
    """ this funktion translates planes from the rhino cordinate system to
    the robot cordinate system 
    """
    robot_plane = rhino_plane.Clone()
    _r_matrix = rg.Transform.PlaneToPlane(rg.Plane.WorldXY, set_robot_base_plane_from_pts())
    robot_plane.Transform(_r_matrix)
    return robot_plane

def pickup_brick(pick_up_plane, script):
    """Pick up a brick procedure

    Parameters
    ----------
    pick_up_plane : rhino.geometry.plane
    
    Returns:
    Procedure for pickin up plane
    """
    accel = 0.3    # m/s2
    vel = 0.5      # m/s

    safe_distance = 50
    
    way_planes = []

    safe_plane = pick_up_plane.Clone()
    safe_plane.Translate(rg.Vector3d(0, 0, safe_distance))

    script += ur.move_l(safe_plane, accel, vel)
    way_planes.append(safe_plane)

    script += ur.move_l(pick_up_plane, accel, vel)
    way_planes.append(pick_up_plane)

    script += ur.set_digital_out(0, True)
    script += ur.sleep(1)

    script += ur.move_l(safe_plane, accel, vel)
    way_planes.append(safe_plane)

    return script 

def place_brick(plane, script):
    """
    this function gereates the robotic sequience for placing a brick
    Requires a plane wich describes the possition of the brick"""

    safe_distance = 50
    accel = 0.1
    vel = 0.3
    way_planes = []

    safe_plane = plane.Clone()
    safe_plane.Translate(rg.Vector3d(0, 0, safe_distance))

    script += ur.move_l(safe_plane, accel, vel)
    way_planes.append(safe_plane)

    script += ur.move_l(plane, accel, vel)
    way_planes.append(plane)

    script += ur.set_digital_out(0, False)
    script += ur.sleep(1)

    script += ur.move_l(safe_plane, accel, vel)
    way_planes.append(safe_plane)

    return script

def glue(plane, script):
    """
    this function gereates the robotic sequience for using_glue
    Requires a plane wich describes the possition of the brick"""

    safe_distance = 50
    accel = 0.5
    vel = 1
    
    way_planes = []

    safe_plane = plane.Clone()
    safe_plane.Translate(rg.Vector3d(0, 0, safe_distance))

    script += ur.move_l(safe_plane, accel, vel)
    way_planes.append(safe_plane)

    script += ur.move_l(plane, accel, vel)
    way_planes.append(plane)
    
    script += ur.move_l(safe_plane, accel, vel)
    way_planes.append(safe_plane)

    return script



""" Robotic fabrication procedure
"""
script = ""
script = tcp(script)

"""pick _up plane is measured in the robot base plane
"""
pick_up_planes =[]
for i in range(3):  # rows x-direction
    for j in range(12):  # rows y-direction
        for k in range(6):
            x_pos = k * (Brick.REFERENCE_LENGTH)
            y_pos = j * (Brick.REFERENCE_WIDTH)
            z_pos = i * (Brick.REFERENCE_HEIGHT)
            origin = rg.Point3d(-60+x_pos, 508-y_pos, 6.0+z_pos)
            pick_up_plane = rg.Plane(origin, rg.Vector3d.XAxis, rg.Vector3d.YAxis)
            pick_up_plane.Rotate(m.radians(-90), rg.Vector3d.ZAxis)
            pick_up_planes.append(pick_up_plane)
pick_up_planes.reverse()


robot_planes = []


"""We are translating all way_planes from rhino base to robot_base
"""
for rhino_plane in (rhino_base_way_planes):
    robot_planes.append(rhino_to_robot_space(rhino_plane))

glue_plane = rg.Plane(rg.Point3d(178.4, 466.2, 17.5), rg.Vector3d.XAxis, rg.Vector3d.YAxis)
glue_plane.Rotate(m.radians(-90), rg.Vector3d.ZAxis)


# set the start postion 
s_pos = [ m.radians(94.51),
   m.radians(-85.99),
   m.radians(-126.91),
   m.radians(-57.21),
   m.radians(90),
   m.radians(0)]
script += ur.move_j(s_pos, 0.4, 0.4)

for i in range(len(robot_planes)-1):
    #pick up a plane 
    if i< 24:
        script = pickup_brick(pick_up_planes[i], script)
        script = place_brick(robot_planes[i], script)
    else:
        script = pickup_brick(pick_up_planes[i], script)
        script = glue(glue_plane, script)
        script = place_brick(robot_planes[i], script)


#for robot_plane, pick_up_plane in zip(robot_planes, pick_up_planes):
#    #pick up a plane 
#    script = pickup_brick(pick_up_plane, script)
#    script = glue(glue_plane, script)
#    script = place_brick(robot_plane, script)


script = c.concatenate_script(script)

if send == True :
    c.send_script(script, "192.168.10.10")
# ---------- end fabrication ----------

# ---- group: Gule
number_slider_3 = Slider(75, range=0..1000)
dom = ConstructDomain(DomainStart=number_slider_3, DomainEnd=expr("x*-1", number_slider_3))
pt_2 = Point(fabrication.glue_plane)
rectangle = Rectangle(Plane=pt_2, XSize=dom, YSize=dom, Radius=0)  # -> Rectangle, Length

# ---- group: Brick
pln = Plane(fabrication.robot_planes)
preview = CustomPreview(Geometry=python_2.bricks, Material=ColourSwatch(SwatchColor=RGBA(0, 0, 0, 101)))
points_2 = PointList(Points=pln, Size=Slider(1.22, range=0..10))

# ---- group: Robot_ enviroment
preview_2 = CustomPreview(Geometry=robotmodel, Material=ColourSwatch(SwatchColor=RGBA(255, 255, 255, 46)))

# ----
number_slider_4 = Slider(10, range=0..10)
panel_3 = Panel(fabrication.script)  # disabled

pln_2 = Plane(fabrication.pick_up_planes)
points_3 = PointList(Points=pln_2, Size=Slider(2, range=0..10))

plnaxis = PlaneAxis(P=fabrication.glue_plane, B=number_slider_4)
plnaxis_2 = PlaneAxis(P=fabrication.pick_up_planes, B=number_slider_4)

# ==== cluster PlaneAxis: show plane X Y Z axis.
P = ClusterInput()
B = ClusterInput()
deplane = DeconstructPlane(Plane=graft(P))  # -> Origin, XAxis, YAxis, ZAxis
multiplication = Multiplication(A=[deplane.XAxis, deplane.YAxis, deplane.ZAxis], B=B)
vdisex = VectorDisplayEx(
    Point=deplane.Origin,
    Vector=multiplication,
    Colour=[ColourSwatch(SwatchColor=RGB(235, 52, 52)), ColourSwatch(SwatchColor=RGB(90, 207, 48)), ColourSwatch(SwatchColor=RGB(54, 126, 227))],
    Width=2)
